# Grasshopper definition Example.gh (Grasshopper 1.0.7)
# plug-ins: SplitCMYK

construct_point = ConstructPoint(XCoordinate=Slider(0.32, range=0..1), YCoordinate=Slider(0.36, range=0..1), ZCoordinate=0)
image_sampler = ImageSampler(
    construct_point,
    FilePath="/Users/dkeners/Downloads/Artboard 1.png",
    Filter="Colour",
    Interpolate=False,
    Umax=1,
    Umin=0,
    Vmax=1,
    Vmin=0,
    Wrap=1)
split_cmyk = SplitCMYK(Colour=image_sampler)  # -> Cyan, Magenta, Yellow, Key
panel = Panel(split_cmyk.Cyan)
panel_2 = Panel(split_cmyk.Magenta)
panel_3 = Panel(split_cmyk.Yellow)
panel_4 = Panel(split_cmyk.Key)
